# Grasshopper definition training.gh (Grasshopper 1.0.5)
# plug-ins: HoopSnake, GH_CPython

xy = XYPlane(Origin=Point(0, 0, 0))
sight_line_distance = Slider(60, range=0..100)
sight_line_count = Slider(16, range=3..16)
road_obstacles = Curve(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)

subtraction = Subtraction(A=sight_line_count, B1=1)
division = Division(APi=3.141592654, B=subtraction)
series = Series(S5=-1.570796327, Step=division, Count=sight_line_count)

# ----
# CALCULATE STATE
flatten = FlattenTree(Tree=road_obstacles, Path="{0}")
series_2 = Series(Start=1, N0=0, Count=sight_line_count)  # -> graft(Series)

# ----
# SEND STATE TO SERVER
panel = Panel("Format(\"{0:0.000000000000000}\", x)")

# ----
# ACTIONS
actions = Panel(""".1
0
-.1""")
multiplication = Multiplication(A=actions, BPi=3.141592654)

speed = Slider(15, range=1..20)

punishment = Panel("-1")

states = Panel(join)
action = Panel(action_2)

reward = Panel(addition)

hs = HoopSnake(
    StartingData=xy,
    Data=filter_4,
    Hoopsnake_Data_autoUpdate=False,
    Hoopsnake_Data_dataLimit=2147483647,
    Hoopsnake_Data_resetCounter=True,
    Hoopsnake_Data_updateView=True)  # -> Feedback, FeedbackHistory, LoopsCounter, IterationsCounter
orientation_plane = Plane(hs.Feedback)
iteration = Panel(hs.IterationsCounter)

rectangle = Rectangle(Plane=orientation_plane, XSize=Domain(-2, 2), YSize=Domain(-5, 5), Radius=0)  # -> Rectangle, Length

deplane = DeconstructPlane(Plane=orientation_plane)  # -> Origin, XAxis, YAxis, ZAxis
# CREATE SIGHTLINES
vrot = Rotate(Vector=deplane.YAxis, XZ=Vector(0, 0, 1), Angle=series)
line = LineSDL(Start=deplane.Origin, Direction=vrot, Length=sight_line_distance)

ccx = CurveCurve(CurveA=graft(line), CurveB=flatten)  # -> Points, ParamsA, ParamsB
trim = TrimTree(Tree=ccx.ParamsA, Depth=1)
merge = Merge(Data1=trim, Data2=series_2)
sort = SortList(Keys=merge)  # -> Keys, ValuesA
item = ListItem(List=sort.Keys, Index=0, Wrap=True)

eval = EvaluateCurve(Curve=graft(line), Parameter=item)  # -> Point, Tangent, Angle

flatten_2 = FlattenTree(Tree=item, Path="{0}")
rev = ReverseList(List=flatten_2)
eval_2 = Evaluate(F=panel, x=rev)
join = TextJoin(Text=eval_2, Join=" ")
gh_client = Gh_client(state_inp=join)  # -> action_out; inputs state_inp: list
# ---------- gh_client: Python ----------
# -*- coding: utf-8 -*-
""" 
Python Script
Created on  Monday November 2018 05:09:38 
@author:  Nariddh 

[desc]
Description of the plugin Here
Write here any thing... 
[/desc]

ARGUMENTS:
----------
<inp> 
    state_inp
</inp>

RETURN:
----------
<out>
    action_out
</out>
"""

from socket import socket, AF_INET, SOCK_STREAM

HOST = '127.0.0.1'
PORT = 8080

# Encode GH input
state_str = str(state_inp)
state_byt = state_str.encode()

# Send State
with socket(AF_INET, SOCK_STREAM) as s:
    s.connect((HOST, PORT))
    s.send(state_byt)

# Receive Action
with socket(AF_INET, SOCK_STREAM) as s:
    s.connect((HOST, PORT))
    action_byt = s.recv(1024)

action_out = action_byt.decode()
# ---------- end gh_client ----------
action_2 = Number(gh_client)

item_2 = ListItem(List=multiplication, Index=action_2, Wrap=True)

# ----
# ACT
prot = RotatePlane(Plane=orientation_plane, Angle=item_2)
deplane_2 = DeconstructPlane(Plane=prot)  # -> Origin, XAxis, YAxis, ZAxis
amp = Amplitude(Vector=deplane_2.YAxis, Amplitude=speed)
move = Move(Geometry=prot, Motion=amp)  # -> Geometry, Transform

# ----
# TERMINATION CONDITION
ln = Line(StartPoint=orientation_plane, EndPoint=move.Geometry)
ccx_2 = CurveCurve(CurveA=ln, CurveB=road_obstacles)  # -> Points, ParamsA, ParamsB
flatten_3 = FlattenTree(Tree=ccx_2.Points, Path="{0}")
lng = ListLength(List=flatten_3)

# ----
# VIZ
car = Rectangle(rectangle.Rectangle)
sightlines = Line(line)
end_points = Point(eval.Point)
action_line = Line(ln)

# ----
# PLAYING AROUND WITH REWARD SCHEMAS
equals = Equality(FirstNumber=hs.IterationsCounter, SecondNumber=0)  # -> Equality, Inequality
num = Number(hs.IterationsCounter)
filter = StreamFilter(Gate=equals.Equality, Stream1=0)
filter_2 = StreamFilter(Gate=lng, Stream1=num)
filter_3 = StreamFilter(Gate=lng, Stream1=punishment)
rec = DataRecorder([filter, filter_2], DataLimit=1, RecordData=True)
subtraction_2 = Subtraction(A=num, B=rec)
division_2 = Division(A=subtraction_2, B10=10)
addition = Addition(A=division_2, B=filter_3)

# ----
# SEND REWARD TO SERVER
gh_client_2 = Gh_client(done_inp=lng, reward=addition)  # -> done_out; inputs done_inp: list, reward: list
# ---------- gh_client_2: Python ----------
# -*- coding: utf-8 -*-
""" 
Python Script
Created on  Monday November 2018 05:09:38 
@author:  Nariddh 

[desc]
Description of the plugin Here
Write here any thing... 
[/desc]

ARGUMENTS:
----------
<inp>
    done_inp
</inp>
<inp> 
    reward
</inp>

RETURN:
----------
<out>
    done_out
</out>
"""

from socket import socket, AF_INET, SOCK_STREAM

HOST = '127.0.0.1'
PORT = 8081

# Encode GH input
reward_str = str(reward)
reward_byt = reward_str.encode()

# Send Reward
with socket(AF_INET, SOCK_STREAM) as s:
    s.connect((HOST, PORT))
    s.send(reward_byt)

# Send Done Through
done_out = done_inp
# ---------- end gh_client_2 ----------
# RESET
filter_4 = StreamFilter(Gate=gh_client_2, Stream0=move.Geometry, Stream1=xy)
