# Grasshopper definition import_osm.gh (Grasshopper 1.0.7)

osm_file_location = FilePath("C:\Users\kheann\Desktop\Vienna\GetOSM_data\osm2rhino\osmlib.py")
osm_file_location_2 = FilePath("C:\Users\kheann\Desktop\Vienna\GetOSM_data\osm2rhino\ViennaSite.osm")
library_osmlib_py = Panel(osm_file_location)
mapfile_osm = Panel(osm_file_location_2)
python_script = PythonScript(library=library_osmlib_py, osmfile=mapfile_osm)  # -> out, relations, ways, nodes, longitude, latitude
# ---------- python_script: Python ----------
import os, sys
path = os.path.split(library)[:-1]
if path not in sys.path:
    sys.path.append(path)
import osmlib
reload(osmlib)
from osmlib import OsmXmlFileParser, OsmObjects, OsmGeometry
from osmlib import Mercator, ProgressBar
import rhinoscriptsyntax as rs

filename = os.path.split(osmfile)[-1]
progress = ProgressBar('Load {} (Press Esc to abort)'.format(filename))
osmxml = OsmXmlFileParser(fileloc=osmfile, options={}, progress=progress)
osmobj = OsmObjects(osmxml)
osmgeo = OsmGeometry(osmxml, osmobj)

relations = osmgeo.relations
ways = osmgeo.ways
nodes = osmgeo.nodes
longitude = osmxml.bounds.minlon, osmxml.bounds.maxlon
latitude = osmxml.bounds.minlat, osmxml.bounds.maxlat
# ---------- end python_script ----------
create_points = BooleanToggle(True)
create_breps = BooleanToggle(False)
create_curves = BooleanToggle(True)
python_script_2 = PythonScript(relations=python_script.relations, make_b=create_breps, make_c=create_curves, make_p=create_points)  # -> out, breps, brep_tags, brep_paths, curves, curve_tags, curve_paths, points, point_tags, point_paths; inputs relations: list, make_b: Boolean, make_c: Boolean, make_p: Boolean
# ---------- python_script_2: Python ----------
import System
import Grasshopper
import Grasshopper.Kernel.Data.GH_Path as gh_path

h = 3.8 # floor2floor height (levels * h = extrusion height)

_breps_tree = Grasshopper.DataTree[System.Object]()
_breptags_tree = Grasshopper.DataTree[System.Object]()
_brep_paths = Grasshopper.DataTree[System.Object]()
_curves_tree = Grasshopper.DataTree[System.Object]()
_curvetags_tree = Grasshopper.DataTree[System.Object]()
_curve_paths = Grasshopper.DataTree[System.Object]()
_nodes_tree = Grasshopper.DataTree[System.Object]()
_nodetags_tree = Grasshopper.DataTree[System.Object]()
_node_paths = Grasshopper.DataTree[System.Object]()

for rid, r in enumerate(relations):

    if make_b:
        # 3d-buildings, 3d-objects (fountain, wall, ...)
        objs3d = [r.buildings3d.getExtrusions(h), r.objects3d.getExtrusions(h)]
        for id, rh_extrusions in enumerate(objs3d):
            if rh_extrusions:
                _brep_paths.Add(gh_path(rid, id), gh_path(rid))
                for rh_extrusion in rh_extrusions:
                    _breps_tree.Add(rh_extrusion, gh_path(rid, id))
                    _breptags_tree.Add(str(r.tags), gh_path(rid, id))

    if make_c:
        # 2d-curves
        objs = [r.buildings3d, r.buildings2d, r.objects3d, r.objects2d]
        for id, item in enumerate(objs):
            inner_ways, inner_crvs, outer_ways, outer_crvs = item.getCurves()
            
            # 2d-outer-curves
            if outer_crvs:
                _curve_paths.Add(gh_path(rid, id, 0), gh_path(rid))
                for i in range(0, len(outer_crvs)):
                    rh_crv = outer_crvs[i]
                    tags = outer_ways[i].tags
                    _curves_tree.Add(rh_crv, gh_path(rid, id, 0))
                    _curvetags_tree.Add(str(tags), gh_path(rid, id, 0))

            # 2d-inner-curves
            if inner_crvs:
                _curve_paths.Add(gh_path(rid, id, 1), gh_path(rid))
                for i in range(0, len(inner_crvs)):
                    rh_crv = inner_crvs[i]
                    tags = inner_ways[i].tags
                    _curves_tree.Add(rh_crv, gh_path(rid, id, 1))
                    _curvetags_tree.Add(str(tags), gh_path(rid, id, 1))

    if make_p:
        # 2d-nodes
        if r.nodes:
            _node_paths.Add(gh_path(rid, 0), gh_path(rid))
            for id, node in enumerate(r.nodes):
                _nodes_tree.Add(node.point, gh_path(rid, id))
                _nodetags_tree.Add(str(node.tags), gh_path(rid, id))

##### gh
breps = _breps_tree
brep_tags = _breptags_tree
brep_paths = _brep_paths
curves = _curves_tree
curve_tags = _curvetags_tree
curve_paths = _curve_paths
points = _nodes_tree
point_tags = _nodetags_tree
point_paths = _node_paths

"""
##### read from gh_tree example
for branch_id in range(0, _brep_paths.BranchCount):
    for path in _brep_paths.Branch(branch_id):
        print path
        print _breps_tree.Branch(gh_path(path))
"""
# ---------- end python_script_2 ----------
python_script_3 = PythonScript(ways=python_script.ways, make_b=create_breps, make_c=create_curves)  # -> out, breps, brep_tags, curves, curve_tags; inputs ways: list, make_b: Boolean, make_c: Boolean
# ---------- python_script_3: Python ----------
h = 3.8 # floor2floor height (levels * h = extrusion height)

_breps = []
_brep_tags = []
_curves = []
_curve_tags = []

for w in ways:

    if make_b:
        # 3d-buildings
        rh_extrusions = w.buildings3d.getExtrusions(h)
        for rh_extrusion in rh_extrusions:
            _breps.append(rh_extrusion)
            _brep_tags.append(str(w.tags))

        # 3d-objects (fountain, wall, ...)
        rh_extrusions = w.objects3d.getExtrusions(h)
        for rh_extrusion in rh_extrusions:
            _breps.append(rh_extrusion)
            _brep_tags.append(str(w.tags))

    if make_c:
        # 2d-curves
        for item in [w.buildings3d, w.buildings2d, w.objects3d, w.objects2d]:
            _, _, outer_ways, outer_crvs = item.getCurves()
            for i in range(0, len(outer_crvs)):
                way = outer_ways[i]
                _curves.append(outer_crvs[i])
                _curve_tags.append(str(way.tags))

##### gh
breps = _breps
brep_tags = _brep_tags
curves = _curves
curve_tags = _curve_tags
# ---------- end python_script_3 ----------
python_script_4 = PythonScript(nodes=python_script.nodes, make_p=create_points)  # -> out, points, tags; inputs nodes: list, make_p: Boolean
# ---------- python_script_4: Python ----------
node_pts = []
node_tags = []

if make_p:
    for node in nodes:
        node_pts.append(node.point)
        node_tags.append(str(node.tags))

##### gh
points = node_pts
tags = node_tags
# ---------- end python_script_4 ----------
curve = Curve(python_script_2.curves)
brep = Brep(python_script_3.breps)
python_script_5 = PythonScript(objects=python_script_3.curves, tags=python_script_3.curve_tags)  # -> out, A; inputs objects: tree, tags: tree
# ---------- python_script_5: Python ----------
# -*- coding: utf-8 -*-

filtered_objs = []
for i in range(objects.BranchCount):
    path = objects.Path(i)
    obj_data = objects.Branch(i)
    obj_tags = tags.Branch(i)
    #print i, path
    for j in range(len(obj_data)):
        #print '   ', j, obj_data[j]
        #print '   ', j, obj_tags[j]
        tag = obj_tags[j]
        if 'highway' in tag and 'footway' in tag:
            filtered_objs.append(obj_data[j])


A = filtered_objs
# ---------- end python_script_5 ----------
point = Point(python_script_4.points)
curve_2 = Curve(python_script_5.A)
list_item = ListItem(List=flatten(python_script_2.brep_paths), Index=Slider(0, range=0..3), Wrap=True)
tree_branch = TreeBranch(Tree=python_script_2.breps, Path=list_item, MaintainPaths=True)
